% Simulink data dictionary Quadcopter_Physical_Architecture_DD.sldd

DataBus_4G = Simulink.Bus()
  VideoFeed: double
  HealthMonitoringData: double
  Telemetry: double

ChargingSystemDatabus = Simulink.Bus()
  ChargeState: double
  SystemHealthy: double
  BatteryPowerRemaining: double
  BatteryTemperature: double
  ChargingSystemTemperature: double

GCSCmds = Simulink.Bus()
  CalibrateIMU: double
  EmergencyShutoff: double
  Land: double
  Takeoff: double

GenericCommandBus = Simulink.Bus()
  OperatingMode: double
  Roll: double
  Pitch: double
  Yaw: double
  Vertical: double
  Lateral: double
  VideoEnable: double
  VideoQuality: double

GenericPowerBusInfo = Simulink.Bus()
  BusVoltage: double
  BusCurrent: double

GenericRadioControl = Simulink.Bus()
  Range: double
  Mode_1: double
  Reset: double

PCDSTemperatures = Simulink.Bus()
  InputConditioningTemperature: double
  MotorPowerTemperature: double
  BusTemperature_12V: double
  BusTemperature_5V: double
  BusTemperature_3p3V: double

PowerElectronicsBus = Simulink.Bus()
  ChargingSystemDatabus: double
  Bus_MotorPower: double
  Bus_12V: double
  Bus_5V: double
  Bus_3p3V: double
  PCDSTemperatures: double

RadioCommandBus = Simulink.Bus()
  RF: double
  WiFi: double
  Cellular4G: double

RadioControlBus = Simulink.Bus()
  RF: double
  WiFi: double
  Cellular4G: double

SensorCommandBus = Simulink.Bus()
  GPSCommand: double
  GyroCommand: double

SensorGPSCommandBus = Simulink.Bus()
  SensorGPSCommandBus: double

SensorGyroCommandBus = Simulink.Bus()
  SensorGyroCommandBus: double

TelemetryBus = Simulink.Bus()
  TelemetryBus: double

PowerBusAvionics = Simulink.Bus()
  Power_12V: double
  Power_5V: double
  Power_3p3V: double

GPSDataExternal = Simulink.Bus()
  GPSDataExternal: double

SensorDatabus = Simulink.Bus()
  GPSData: double
  AccelData: double
  GyroData: double
  AmbientTempData: double
  AmbientPressureData: double
  UltrasonicSensorData_Port: double
  UltrasonicSensorData_Forward: double
  UltrasonicSensorData_Altitude: double
  UltrasonicSensorData_Starboard: double
  UltrasonicSensorData_Aft: double

GPSData = Simulink.Bus()
  GPSData: double

AccelData = Simulink.Bus()
  AccelData: double

AmbientTempData = Simulink.Bus()
  AmbientTempData: double

AmbientPressureData = Simulink.Bus()
  AmbientPressureData: double

GyroCommand = Simulink.Bus()
  GyroCommand: double

GyroData = Simulink.Bus()
  GyroData: double

UltrasonicSensorData = Simulink.Bus()
  UltrasonicSensorData: double

VideoFeed = Simulink.Bus()
  VideoFeed: double

WiFi_QC_VideoFeed = Simulink.Bus()
  WiFi_QC_VideoFeed: double

HealthData = Simulink.Bus()
  HealthData: double

Telemetry = Simulink.Bus()
  Telemetry: double

PowerBusMotor = Simulink.Bus()
  PowerBusMotor: double

MotorCommandBus = Simulink.Bus()
  MotorCommandBus: double

MotorDataBus = Simulink.Bus()
  MotorDataBus: double

Temperature = Simulink.Bus()
  Temperature: double

Power = Simulink.Bus()
  Power: double

Speed = Simulink.Bus()
  Speed: double

VideoCommand = Simulink.Bus()
  VideoCommand: double

Healthy = Simulink.Bus()
  Healthy: double

Command = Simulink.Bus()
  Command: double

Data = Simulink.Bus()
  Data: double

RadioAntennas = Simulink.Bus()
  RadioAntennas: double