# Requirement set Quadcopter_Physical_Architecture_REQ (R2024a)

## 1 [9] Physical Requirements
ExternalType: Requirement
ExternalUID: _2021x_2_f280357_1675889200193_486319_13333

### 1.1 [9.1] Weight
The quadcopter weight shall not exceed 10 kg.
ExternalType: Requirement
ExternalUID: _2021x_2_f280357_1675888843280_713106_13317

### 1.2 [9.4] Motors
The quadcopter shall have four independent motors.
ExternalType: Requirement
ExternalUID: _2021x_2_f280357_1675888912760_269660_13323

### 1.3 [9.2] Cost
The quadcopter cost shall not exceed $1000 USD.
ExternalType: Requirement
ExternalUID: _2021x_2_f280357_1675888928025_124730_13326

### 1.4 [9.3] Power
The quadcopter shall be battery powered.
ExternalType: Requirement
ExternalUID: _2021x_2_f280357_1675888989016_14556_13330

## 2 [10] Performance
Performance Requirements
ExternalType: Requirement
ExternalUID: _2021x_2_f280357_1675889225919_800810_13337

### 2.1 [10.1] Hover
The quadcopter shall be able to hover for 10 minutes at normal power draw.
ExternalType: Requirement
ExternalUID: _2021x_2_f280357_1675888879855_824941_13320

## 3 [11] Communications
Communications Requirements
ExternalType: Requirement
ExternalUID: _2021x_2_f280357_1675889276009_234989_13340

### 3.1 [#9] WiFi
The quadcopter shall interface with the ground station using a WiFi radio.
ExternalType: Requirement
ExternalUID: _2021x_2_f280357_1675888639287_35654_13303

### 3.2 [11.1] RF
The quadcopter shall interface with the ground station using an RF radio.
ExternalType: Requirement
ExternalUID: _2021x_2_f280357_1675888672960_179429_13307

### 3.3 [11.2] 4G
The quadcopter shall interface with the ground station using a 4G radio.
ExternalType: Requirement
ExternalUID: _2021x_2_f280357_1675888826647_360207_13314

## 4 [12] Payload
Payload Requirements
ExternalType: Requirement
ExternalUID: _2021x_2_f280357_1675889444703_270006_13354

### 4.1 [12.1] Camera
The quadcopter shall have a visual sensor.
ExternalType: Requirement
ExternalUID: _2021x_2_f280357_1675889452793_274114_13357

### 4.2 [12.2] Video Feed
The quadcopter shall use the communication system to stream its video feed to the ground station.
ExternalType: Requirement
ExternalUID: _2021x_2_f280357_1675889472393_686236_13360