% Simulink data dictionary SkyzerContractorSystemModel_DD.sldd

ExtendCommand = Simulink.Bus()
RetractCommand = Simulink.Bus()
AlternateExtendCommand = Simulink.Bus()
WeightOnWheels = Simulink.Bus()
WeightOffWheels = Simulink.Bus()
RetractionComplete = Simulink.Bus()
ExtensionComplete = Simulink.Bus()
AlternateExtensionComplete = Simulink.Bus()
ShutdownVehicle = Simulink.Bus()