% Simulink data dictionary SkyzerSystemModel_DD.sldd

EmergencyShutoff = Simulink.Bus()
GroundStationCommand = Simulink.Bus()

Beacon = Simulink.Bus()
  Frequency: double
  Location: double

GroundStationCommunicationSevered = Simulink.Bus()
GroundContact = Simulink.Bus()
Strut = Simulink.Bus()
BrakeDisk = Simulink.Bus()
Pin = Simulink.Bus()
Bolted = Simulink.Bus()
SlidingTube = Simulink.Bus()
Bearing = Simulink.Bus()
ExtensionCommand = Simulink.Bus()
RetractionCommand = Simulink.Bus()
TowingSignal = Simulink.Bus()
ExtendedSignal = Simulink.Bus()
AlternateExtensionCommand = Simulink.Bus()
RetractedSignal = Simulink.Bus()
DoorsClosed = Simulink.Bus()
ShipSignal = Simulink.Bus()
LandingSignal = Simulink.Bus()
ShutdownCommand = Simulink.Bus()
HoveringSignal = Simulink.Bus()